# Grasshopper definition Spiraltower.gh (Grasshopper 1.0.7)
# plug-ins: MeshEdit Components

pt = ConstructPoint(XCoordinate=0, YCoordinate=0, ZCoordinate=7)
pt_2 = ConstructPoint(XCoordinate=1, YCoordinate=0, ZCoordinate=4)
pt_3 = ConstructPoint(XCoordinate=5, YCoordinate=0, ZCoordinate=0)
pt_4 = ConstructPoint(XCoordinate=2, YCoordinate=0, ZCoordinate=2)
pt_5 = Point(Point(0, 0, 0))
merge = Merge(Data1=pt_3, Data2=pt_4, Data3=pt_2, Data4=pt)
ln = Line(StartPoint=pt_5, EndPoint=pt)
intcrv = Interpolate(Vertices=merge, Degree=3, Periodic=False, KnotStyle=1)  # -> Curve, Length, Domain

rh_in_profile = Slider(3, range=3..10)
rh_in_rotation = Slider(12, range=0..50)
arrpolar = PolarArray(Geometry=intcrv.Curve, Plane=PlaneXY(0, 0, 0), Count=rh_in_profile, Angle=6.283185307)  # -> Geometry, Transform
N = Count(rh_in_rotation)
divide = DivideCurve(Curve=arrpolar.Geometry, Count=N, Kinks=False)  # -> Points, Tangents, Parameters
series = Series(Start=0, Step=-1, Count=N)  # -> graft(Series)
series_2 = Series(Start=0, Step=1, Count=N)  # -> graft(Series)
flip = FlipMatrix(Data=divide.Points)
shift = ShiftList(List=flip, Shift=series_2, Wrap=True)
shift_2 = ShiftList(List=flip, Shift=series, Wrap=True)
flip_2 = FlipMatrix(Data=shift)
flip_3 = FlipMatrix(Data=shift_2)
intcrv_2 = Interpolate(Vertices=flip_2, Degree=3, Periodic=False, KnotStyle=1)  # -> flatten(Curve), Length, Domain
intcrv_3 = Interpolate(Vertices=flip_3, Degree=3, Periodic=False, KnotStyle=1)  # -> Curve, Length, Domain

loft = Loft(
    Curves=[intcrv_2.Curve, intcrv_3.Curve],
    Options={Adjust=False, Closed=True, LoftEnds=0, LoftSimp=0, LoftType=0, Rebuild=10, Refit=0.01})
join = BrepJoin(Breps=loft)  # -> Breps, Closed
mesh = MeshBrep(
    Brep=join.Breps,
    Settings={GridMaxCount=0, GridMinCount=16, JaggedSeams=False, MaxEdgeLength=0, MinEdgeLength=0.0001, MinTolerance=0, Refine=True, RefineAngle=0, RelativeTolerance=0.65, SimplePlanes=True, Tolerance=0})  # -> flatten(Mesh)
triangulate = MeshTriangulate(Mesh=mesh, ShortDiagonal=True)  # -> flatten(Mesh)
rh_out_mesh = Mesh(triangulate)
